# Grasshopper definition foil_working.gh (Grasshopper 1.0.7)
# plug-ins: OpenNest, eleFront

resolution = Slider(19, range=1..100, expression="x * 10")
chord_length = Slider(10, range=0..20)
rib_spacing = Slider(5.875, range=1..15)
y_thickness = Slider(0.1, range=0..0.1)
foil_type = ValueList({"NACA0012": 0.12, "NACA0009": 0.09}, selected="NACA0009")
height = Slider(38, range=0..48)

cnc_y_len = Slider(30, range=0..100)
cnc_x_len = Slider(44, range=0..100)
concat = Concatenate(FragmentA=chord_length, FragmentB="0", JoinSeparator=",")
z_axis = UnitZ(Factor=height)
pt = Point(Point(0, 0, 0))

thickness_2 = Division(A=y_thickness, B="2")
chord_2 = Division(A=chord_length, B="2")

line = LineSDL(Start=pt, Direction=z_axis, Length=z_axis)
line_2 = LineSDL(Start=concat, Direction=z_axis, Length=z_axis)
end = EndPoints(Curve=line_2)  # -> Start, End
end_2 = EndPoints(Curve=line)  # -> Start, End
Y = UnitY(Factor=y_thickness)
srf4pt = _4PointSurface(CornerA=end_2.Start, CornerB=end.Start, CornerC=end.End, CornerD=end_2.End)
y_thickness_offset = OffsetSurface(Surface=srf4pt, Distance=thickness_2, Retrim=True)
vertical_frame = Extrude(Base=y_thickness_offset, Direction=Y)

python = GhPythonScript(chord_length=chord_length, num_points=resolution, foil_type=foil_type)  # -> a, b, c; inputs chord_length: Int32, num_points: Int32
# ---------- python: Python ----------
import Rhino.Geometry as rg
import math

def naca(x, chord_length):
    t = foil_type # NACA0012 == 0.12 
    c = chord_length
    yt = 5 * t * c * (0.2969 * math.sqrt(x / c) - 0.1260 * (x / c) - 0.3516 * (x / c)**2 + 0.2843 * (x / c)**3 - 0.1015 * (x / c)**4)
    return yt

def create_naca_curve(chord_length, num_points):
    upper_points = []
    lower_points = []

    for i in range(num_points + 1):
        x = i * (chord_length / num_points)
        yt = naca(x, chord_length)
        upper_points.append(rg.Point3d(x, yt, 0))
        lower_points.append(rg.Point3d(x, -yt, 0))

    upper_curve = rg.Curve.CreateInterpolatedCurve(upper_points, 3)
    lower_curve = rg.Curve.CreateInterpolatedCurve(lower_points, 3)
    # Join upper and lower curves
    combined_curve = rg.Polyline(upper_points + lower_points[::-1] + [upper_points[0]])


    return upper_curve, lower_curve, combined_curve


# Input parameters

# Generate NACA curves
upper_curve, lower_curve, combined_curve = create_naca_curve(chord_length, num_points)


# Output the curves
a = upper_curve
b = lower_curve
c = combined_curve
# ---------- end python ----------
z_axis_height = UnitZ(Factor=height)
edgesrf = EdgeSurface(CurveA=python.a, CurveB=python.b)
extr = Extrude(Base=edgesrf, Direction=z_axis_height)
contour = Contour(Shape=extr, Point=Point(0, 0, 0), Direction=z_axis_height, Distance=rib_spacing)
brep = Brep(extr)
X = UnitX(Factor=1)
brep_2 = Brep(contour)
planesrf = PlaneSurface(Plane=X, XSize=Domain(-10, 10), YSize=Domain(-10, 10))
z_wt = UnitZ(Factor=y_thickness)
offset = OffsetSurface(Surface=brep_2, Distance=Slider(0, range=0..100), Retrim=True)
bbox = BoundingBox(Content=brep, Plane=planesrf)  # -> Box, Box_2
horizontal_ribs = Extrude(Base=offset, Direction=z_wt)

multiplication = Multiplication(A=chord_length, B=foil_type)
X_2 = UnitX(Factor=rib_spacing)
cap = CapHoles(Brep=vertical_frame)

solid_intersection = SolidIntersection(BrepsA=horizontal_ribs, BrepsB=vertical_frame)
X_3 = UnitX(Factor=expr("x + 1", chord_2))
centroid = Volume(Geometry=solid_intersection)  # -> Volume, Centroid
yz = YZPlane(Origin=centroid.Centroid)
centroid_on_plane = BrepPlane(Brep=solid_intersection, Plane=yz)  # -> Curves, Points
rev = Reverse(Vector=X_3)
fore_slot_half = Extrude(Base=centroid_on_plane.Curves, Direction=rev)
aft_slot_half = Extrude(Base=centroid_on_plane.Curves, Direction=X_3)
cap_2 = CapHoles(Brep=fore_slot_half)
cap_3 = CapHoles(Brep=aft_slot_half)

cap_4 = CapHoles(Brep=horizontal_ribs)
frame_brep = Brep(cap)
ribs_brep = Brep(cap_4)

concat_2 = Concatenate(FragmentA=chord_length, FragmentB=multiplication, JoinSeparator=",")
pt_2 = Point(concat_2)
planesrf_2 = PlaneSurface(Plane=pt_2, XSize=cnc_y_len, YSize=cnc_x_len)
boundary = BoundarySurfaces(Edges=planesrf_2)
divide = DivideDomain²(Domain=planesrf_2, UCount=rib_spacing, VCount=rib_spacing)
subsrf = Isotrim(Surface=boundary, Domain=divide)
area = Area(Geometry=subsrf)  # -> Area, Centroid
xz = XZPlane(Origin=Point(0, 0, 0))
xy = XYPlane(Origin=area.Centroid)
orient = Orient(Source=xz, Target=xy)  # -> Geometry, Transform

vert_sdiff = SolidDifference(BrepsA=flatten(frame_brep), BrepsB=flatten(cap_3))  # -> flatten(Result)
horiz_sdiff = SolidDifference(BrepsA=ribs_brep, BrepsB=cap_2)

cap_5 = CapHoles(Brep=horiz_sdiff)
brep_3 = Brep(cap_5)
debrep = DeconstructBrep(Brep=brep_3)  # -> Faces, Edges, Vertices
area_2 = Area(Geometry=debrep.Faces)  # -> Area, Centroid
pdecon = Deconstruct(Point=area_2.Centroid)  # -> XComponent, YComponent, ZComponent
sort = SortList(Keys=pdecon.ZComponent, ValuesA=debrep.Faces)  # -> Keys, ValuesA
item = ListItem(List=sort.ValuesA, Index=0, Wrap=True)
edges = BrepEdges(Brep=item)  # -> Naked, Interior, NonManifold
join = JoinCurves(Curves=edges.Naked, Preserve=False)  # -> flatten(Curves)

cap_6 = CapHoles(Brep=vert_sdiff)
brep_4 = Brep(cap_6)
debrep_2 = DeconstructBrep(Brep=brep_4)  # -> Faces, Edges, Vertices
area_3 = Area(Geometry=debrep_2.Faces)  # -> Area, Centroid
pdecon_2 = Deconstruct(Point=area_3.Centroid)  # -> XComponent, YComponent, ZComponent
sort_2 = SortList(Keys=pdecon_2.YComponent, ValuesA=debrep_2.Faces)  # -> Keys, ValuesA
item_2 = ListItem(List=sort_2.ValuesA, Index=0, Wrap=True)
edges_2 = BrepEdges(Brep=item_2)  # -> Naked, Interior, NonManifold
join_2 = JoinCurves(Curves=edges_2.Naked, Preserve=False)  # -> flatten(Curves)

txt = Text("foil")
concat_3 = Concatenate(FragmentA=height, FragmentB=chord_length, JoinSeparator="_")
concat_4 = Concatenate(FragmentA=concat_3, FragmentB=y_thickness, JoinSeparator="_")
file = GetCurrentFile()  # -> Folder, FileName, Worksession
concat_5 = Concatenate(FragmentA="foil", FragmentB=concat_4, JoinSeparator="_")
panel = Panel(concat_5)
xz_2 = XZPlane(Origin=Point(0, 0, 0))
orient_2 = Orient(Geometry=join_2, Source=xz_2, Target=PlaneXY(0, 0, 0))  # -> Geometry, Transform
merge = Merge(Data1=join, Data2=orient_2.Geometry)  # -> flatten(Result)

opennest = OpenNest(
    Sheets=planesrf_2,
    Geo=merge,
    Spacing=Slider(0.125, range=0..4),
    Placement=Slider(5, range=0..10),
    Tolerance=Slider(0.01, range=0..1),
    Rotations=Slider(4, range=0..10),
    Iterations=Slider(100, range=0..100),
    Seed=1,
    Reset=True,
    Run=True)  # -> Sheets, Geo, ID, Transform, IDS

ef_layer = EleFrontLayer(Layer=opennest.Sheets)  # -> Layer, FullPath, Hidden, Locked, DisplayColour, MaterialName, Linetype, PrintColour, PrintWidth
bklay = BakeLayers(Layers=ef_layer.Layer, Bake=False)
bake = BakeObjects(Geometry=opennest.Geo, Bake=Button(), createGroups=False)  # -> Message, flatten(Guids)

path = FilePath("/Users/jacob/DXF/")
expgen = ExportGeneric(
    FolderPath=path,
    FileName=panel,
    FileExtension=".dxf",
    RhinoObjects=bake.Guids,
    AxisSystem=PlaneXY(0, 0, 0),
    Export=Toggle(True),
    Overwrite=True,
    networkMode=True,
    ValueTable_Overwrite=False,
    ValueTable_networkMode=True)

panel_2 = Panel(expgen)
